# Grasshopper definition MinBoundBox3d.ghx (Grasshopper 1.0.7)

geometry = Geometry(<curve referenced from the Rhino model>)
stepvolume = Slider(7, range=2..20)
stepplanar = Slider(17, range=2..20)
stepdivider = Slider(3, range=2..10)
panel = Panel("C:\Users\gyula.karli\DEV\Grasshopper Python szkriptek\MinBoundBox3d.py")
path_mapper = PathMapper(geometry, source="{A}", target="{0}")
integer = Integer(stepdivider)
integer_2 = Integer(stepvolume)
integer_3 = Integer(stepplanar)
test = BooleanToggle(False)
file_path = FilePath(panel)
graft_script = GhPythonScript(
    Code=file_path,
    IsTest=test,
    Selection=path_mapper,
    Epsilon=0.001,
    IsBoundaryOpt=Toggle(False),
    IStepVolume=integer_2,
    IStepPlanar=integer_3,
    IStepDivider=integer,
    IMaxIteration=100)  # -> Out, Result
panel_2 = Panel(geometry)
panel_3 = Panel(graft_script.Out)
panel_4 = Panel(graft_script.Result)
